# Grasshopper definition Site - Base Info.gh (Grasshopper 1.0.7)

osm = FilePath("C:\Users\HP\Downloads\map (4).osm")
osm_2 = FilePath("H:\我的云端硬盘\Temp\20211122_GH Terrain with ELK & SRTM\N40W079.hgt")
panel = Panel(osm)
panel_2 = Panel(osm_2)
loc = Location(Stream=panel)  # -> OSMPointData, OSMData, LongitudeDomain, LatitudeDomain
stopo = SRTMTopo(Path=panel_2, Latitude=loc.LatitudeDomain, Longitude=loc.LongitudeDomain)  # -> Points, Curves, Surface
srf = Surface(stopo.Surface)

panel_3 = Panel(loc.LongitudeDomain)
panel_4 = Panel(loc.LatitudeDomain)
# water
waterways = WaterWays(OSMPointData=loc.OSMPointData, XMLData=loc.OSMData, CollectionType=0)  # -> Coastlines, Lakes, Rivers, Riverbanks, Streams, Canals, ManMade, Dams, WaterKey
# highways
highways = Highways(OSMPointData=loc.OSMPointData, XMLData=loc.OSMData, CollectionType=0)  # -> Motorways, MotorwayLinks, Trunks, TrunkLinks, RoadKey
# minor roads
minorroads = MinorRoads(OSMPointData=loc.OSMPointData, XMLData=loc.OSMData, CollectionType=0)  # -> Residential, Unclassified, NotClassified, RoadKey
# railways
railways = RailWays(OSMPointData=loc.OSMPointData, XMLData=loc.OSMData, CollectionType=0)  # -> Rail, Tram, LightRail, Subway, MonoRail, NarrowGauge, RailKey
# buildings
# major roads
majorroads = MajorRoads(OSMPointData=loc.OSMPointData, XMLData=loc.OSMData, CollectionType=0)  # -> Primary, PrimaryLinks, Secondary, SecondaryLinks, Tertiary, RoadKey
genericosm = GenericOSM(OSMPointData=loc.OSMPointData, OSMDataString=loc.OSMData, FeatureKey="shop", FeatureValue="*", CollectionType=0)  # -> FeaturePoints, FeatureKey
genericosm_2 = GenericOSM(OSMPointData=loc.OSMPointData, OSMDataString=loc.OSMData, FeatureKey="building", FeatureValue="*", CollectionType=0)  # -> FeaturePoints, FeatureKey
panel_5 = Panel(majorroads.RoadKey)
panel_6 = Panel(minorroads.RoadKey)
panel_7 = Panel(railways.RailKey)
panel_8 = Panel(waterways.WaterKey)
pline = PolyLine(Vertices=genericosm.FeaturePoints, Closed=False)
pline_2 = PolyLine(Vertices=genericosm_2.FeaturePoints, Closed=False)
pline_3 = PolyLine(Vertices=majorroads.Primary, Closed=False)
pline_4 = PolyLine(Vertices=majorroads.PrimaryLinks, Closed=False)
pline_5 = PolyLine(Vertices=majorroads.Secondary, Closed=False)
pline_6 = PolyLine(Vertices=majorroads.SecondaryLinks, Closed=False)
pline_7 = PolyLine(Vertices=majorroads.Tertiary, Closed=False)
pline_8 = PolyLine(Vertices=minorroads.Residential, Closed=False)
pline_9 = PolyLine(Vertices=minorroads.Unclassified, Closed=False)
pline_10 = PolyLine(Vertices=minorroads.NotClassified, Closed=False)
pline_11 = PolyLine(Vertices=highways.Motorways, Closed=False)
pline_12 = PolyLine(Vertices=highways.MotorwayLinks, Closed=False)
pline_13 = PolyLine(Vertices=highways.Trunks, Closed=False)
pline_14 = PolyLine(Vertices=highways.TrunkLinks, Closed=False)
panel_9 = Panel(highways.RoadKey)
pline_15 = PolyLine(Vertices=railways.Rail, Closed=False)
pline_16 = PolyLine(Vertices=railways.Tram, Closed=False)
pline_17 = PolyLine(Vertices=railways.LightRail, Closed=False)
pline_18 = PolyLine(Vertices=railways.Subway, Closed=False)
pline_19 = PolyLine(Vertices=railways.MonoRail, Closed=False)
pline_20 = PolyLine(Vertices=railways.NarrowGauge, Closed=False)
pline_21 = PolyLine(Vertices=waterways.Coastlines, Closed=False)
pline_22 = PolyLine(Vertices=waterways.Lakes, Closed=False)
pline_23 = PolyLine(Vertices=waterways.Rivers, Closed=False)
pline_24 = PolyLine(Vertices=waterways.Riverbanks, Closed=False)
pline_25 = PolyLine(Vertices=waterways.Streams, Closed=False)
pline_26 = PolyLine(Vertices=waterways.Canals, Closed=False)
pline_27 = PolyLine(Vertices=waterways.ManMade, Closed=False)
pline_28 = PolyLine(Vertices=waterways.Dams, Closed=False)
boundary = BoundarySurfaces(Edges=pline)
boundary_2 = BoundarySurfaces(Edges=pline_2)

majorroads_2 = Curve([pline_5, pline_6, pline_7, pline_4, pline_3])
minorroads_2 = Curve([pline_8, pline_9, pline_10])
highways_2 = Curve([pline_11, pline_12, pline_13, pline_14])
buildings = Curve(pline_2)
railways_2 = Curve([pline_15, pline_16, pline_17, pline_18, pline_19, pline_20])
water = Curve([pline_22, pline_21, pline_24, pline_26, pline_27, pline_28, pline_23, pline_25])

crv = Curve(pline)
srf_2 = Surface(boundary_2)
preview = CustomPreview(Geometry=boundary, Shader=ColourSwatch(SwatchColor=RGB(237, 50, 40)))
preview_2 = CustomPreview(Geometry=[pline_3, pline_4, pline_5, pline_6, pline_7], Shader=ColourSwatch(SwatchColor=RGB(247, 151, 47)))
preview_3 = CustomPreview(Geometry=[pline_10, pline_9, pline_8], Shader=ColourSwatch(SwatchColor=RGB(235, 217, 103)))
preview_4 = CustomPreview(Geometry=[pline_11, pline_12, pline_13, pline_14], Shader=ColourSwatch(SwatchColor=RGB(176, 176, 176)))
preview_5 = CustomPreview(Geometry=[pline_15, pline_16, pline_17, pline_18, pline_19, pline_20], Shader=ColourSwatch(SwatchColor=RGB(84, 84, 84)))
preview_6 = CustomPreview(
    Geometry=[pline_22, pline_21, pline_23, pline_24, pline_25, pline_26, pline_27, pline_28],
    Shader=ColourSwatch(SwatchColor=RGB(138, 206, 242)))
panel_10 = Panel("bake 面用的")
我是线宽 = Number(5)
我是线宽_2 = Number(5)
我是线宽_3 = Number(5)
我是线宽_4 = Number(5)
我是线宽_5 = Number(5)
